vi "index.gviweb"   [LabVIEW NXG 5.1.0]
panel controls:
  "API Key": string
  "password": string
  "Authentication Credentials": i32
  "server url": string = "http://192.168.195.141"
  "username": string = "admin"
  "connect": bool
  "Get Inspection": bool
panel indicators:
  "URL Image": string
  "Remark": string
  "Acceleration X": string
  "Acceleration Y": string
  "Acceleration Z": string
  "Acceleration Timestamp": string
  "Heading": string
  "Longitude": string
  "Latitude": string
  "Output": error
  "loop iteration": i32
  "queue size": i32
types:
  "Client Handle.gtype" = u32
  "Configuration.gtype" = cluster{"Server URL": string, "Session": "Client Handle.gtype", "Raw Session Queue": Queue<"Client Handle.gtype">}
  "Message Session.gtype" = cluster{"Configuration": "Configuration.gtype", "token": string}
uses:
  NI::Skyline::Configuration::Open Configuration.gvi
  NI::Skyline::Configuration::Open Configuration API Key.gvi
  NI::Skyline::MessageHTTP::Open.gvi
  NI::Skyline::MessageHTTP::Subscribe.gvi
  NI::Skyline::MessageHTTP::Read.gvi
  NI::Skyline::MessageHTTP::Get Queue Size Bytes.gvi
diagram:
  # Top-Level WebVIs usually contain a While Loop that never stops so that they can continue running as long as the web page is open in the user's web browser.
  s1 = "Message Session.gtype" {all zero or empty}  # shift register
  while (iteration -> i1) {
    event (timeout = 500) {
      on "connect" Value changed {
        case ($"Authentication Credentials") {
          frame 0, Default {
            call "Open Configuration.gvi"(server url=$"server url", username=$username, password=$password, error in=no error) -> (configuration=w3, error out=w4)
          }
          frame 1 {
            call "Open Configuration API Key.gvi"(server url="https://api.systemlinkcloud.com", api key=$"API Key", error in=no error) -> (configuration=w3, error out=w4)
          }
        }
        call "Open.gvi"(error in=w4, configuration=w3) -> (message session=w5, error out=w6)
        call "Subscribe.gvi"(message session in=w5, topic="example.message.topic", error in=w6) -> (message session out=w2, error out=w1)
      }
      on "Get Inspection" Value changed {
        call "Read.gvi"(message session in=s1, timeout=0, error in=no error) -> (dequeue status=w7, message session out=w2, message=w8, error out=w9)
        case (w7) {
          frame False, Default {
            w1 = w9
          }
          frame True {
            Unflatten From Json(JSON string=w8, error in (no error)=w9, type and defaults=string[] []) -> (error out=w1, value=w10)
            Array Index(array=w10) -> (out0[_]=w11, out1[_]=w12, out2[_]=w13, out3[_]=w14, out4[_]=w15, out5[_]=w16, out6[_]=w17, out7[_]=w18, out8[_]=w19)
            $Remark <- w11
            $"Acceleration X" <- w12
            $"Acceleration Y" <- w13
            $"Acceleration Z" <- w14
            $"Acceleration Timestamp" <- w15
            $Heading <- w16
            $Longitude <- w17
            $Latitude <- w18
            $"URL Image" <- w19
          }
        }
      }
      on "Timeout" {
        call "Get Queue Size Bytes.gvi"(message session in=s1, error in=no error) -> (message session out=w2, queue size=w20, error out=w1)
        $"queue size" <- w20
      }
    }
    $Output <- w1
    $"loop iteration" <- i1
    next s1 = w2
    stop if FALSE
  }
