vi "index.gviweb"   [LabVIEW NXG 5.1.0]
panel controls:
  "Send Remark": bool
  "Take Image": bool
  "Remark": string
  "Tab": i32
  "Authentication Credentials": i32
  "server url": string = "http://192.168.195.141"
  "username": string = "admin"
  "password": string
  "API Key": string
  "connect": bool
panel indicators:
  "URL Image": string
types:
  "Client Handle.gtype" = u32
  "Configuration.gtype" = cluster{"Server URL": string, "Session": "Client Handle.gtype", "Raw Session Queue": Queue<"Client Handle.gtype">}
  "Message Session.gtype" = cluster{"Configuration": "Configuration.gtype", "token": string}
uses:
  WebApp::Start Accelerometer Service.gviweb
  WebApp::Start Compas Service.gviweb
  WebApp::Start GPS Service.gviweb
  WebApp::Library.jsli::Eval
  WebApp::Library.jsli::String
  NI::G Core::Error::Clear Error Cluster.gvi
  NI::Skyline::MessageHTTP::Publish.gvi
  WebApp::Request Image.gviweb
  NI::Skyline::Configuration::Open Configuration.gvi
  NI::Skyline::Configuration::Open Configuration API Key.gvi
  NI::Skyline::MessageHTTP::Open.gvi
  NI::Skyline::MessageHTTP::Subscribe.gvi
diagram:
  call "Start Accelerometer Service.gviweb"() -> (Error Out=w1)
  call "Start Compas Service.gviweb"(Error In=w1) -> (Error Out=w2)
  call "Start GPS Service.gviweb"(Error In=w2) -> (Error Out=w3)
  s1 = w3  # shift register
  s2 = ""  # shift register
  s3 = "Message Session.gtype" {all zero or empty}  # shift register
  while {
    # "example.message.topic": topic name
    # s3: Topic
    # s2: >Picture>
    event (timeout = 200) {
      on "Timeout" {
        case (s1) {
          frame Error, Default {
            # Keep trying to launch the service untill it succeeds.
            # While the base app is starting up this fails. Only once the base app is
            # completely running the services can launch. This is run once.
            disable {
              frame Enabled { }
              frame Disabled {
                call "Start Accelerometer Service.gviweb"() -> (Error Out=w7)
                call "Start GPS Service.gviweb"() -> (Error Out=w8)
                call "Start Compas Service.gviweb"() -> (Error Out=w9)
                Merge Errors(w7, w8, w9) -> (error out=w10)
              }
            }
            w5 = s2
          }
          frame No Error {
            # Gives an error
            # before the first image
            call "Eval"(evalString="picture", error in=s1) -> (return=w11, error out=w12)
            call "String"(arg=w11, error in=w12) -> (return=w13, error out=w14)
            Concatenate Strings("data:image/jpeg;base64,", w13) -> w5
            $"URL Image" <- w5
            call "Clear Error Cluster.gvi"(error in=w14)
          }
        }
        w4 = s1
        w6 = s3
      }
      on "Send Remark" Value changed {
        w15 = ["AccelerationX", "AccelerationY", "AccelerationZ", "AccelerationTimestamp", "Heading", "Longitude", "Latitude"]
        for {
          w16 = each element of w15
          call "Eval"(evalString=w16) -> (return=w18, error out=w19)
          call "String"(arg=w18, error in=w19) -> (return=w20)
          append w20 to w17
        }
        Build Array($Remark, w17, s2) -> w21
        Flatten To Json(anything=w21) -> (JSON string=w22)
        call "Publish.gvi"(message session in=s3, topic="example.message.topic", message=w22, error in=s1) -> (message session out=w6, error out=w4)
        w5 = s2
      }
      on "Take Image" Value changed {
        call "Request Image.gviweb"(Error In=s1) -> (Error Out=w4)
        w5 = s2
        w6 = s3
      }
      on "connect" Value changed {
        case ($"Authentication Credentials") {
          frame 0, Default {
            call "Open Configuration.gvi"(server url=$"server url", username=$username, password=$password, error in=s1) -> (configuration=w23, error out=w24)
          }
          frame 1 {
            call "Open Configuration API Key.gvi"(server url="https://api.systemlinkcloud.com", api key=$"API Key", error in=s1) -> (configuration=w23, error out=w24)
          }
        }
        call "Open.gvi"(error in=w24, configuration=w23) -> (message session=w25, error out=w26)
        call "Subscribe.gvi"(message session in=w25, topic="example.message.topic", error in=w26) -> (message session out=w6, error out=w4)
        w5 = s2
      }
    }
    # w5: >Picture>
    case (w4) {
      frame Error, Default {
        Property Node(instance in=w4) -> ("source"=w27)
        One Button Dialog(message=w27)
      }
      frame No Error { }
    }
    next s1 = w4
    next s2 = w5
    next s3 = w6
    stop if FALSE
  }
