vi "index.gviweb"   [LabVIEW NXG 5.1.0]
panel controls:
  "Progress": i32
  "Test Error": bool
  "Test Running": bool
  "API Key": string
  "password": string
  "Authentication Credentials": i32
  "server url": string = "http://192.168.195.141"
  "username": string = "admin"
  "Connect": bool
panel indicators:
  "Errors": error
types:
  "DataType.gtype" = enum{"Double", "I32", "String", "Boolean", "U64", "Timestamp"}
  "Client Handle.gtype" = u32
  "Configuration.gtype" = cluster{"Server URL": string, "Session": "Client Handle.gtype", "Raw Session Queue": Queue<"Client Handle.gtype">}
  "Tag.gtype" = cluster{"Path": string, "Datatype": "DataType.gtype", "Configuration": "Configuration.gtype"}
uses:
  NI::Skyline::TagHTTP::Write Tag (Boolean).gvi
  NI::Skyline::TagHTTP::Write Tag (I32).gvi
  NI::Skyline::Configuration::Open Configuration.gvi
  NI::Skyline::Configuration::Open Configuration API Key.gvi
  NI::Skyline::TagHTTP::Open Tag.gvi
diagram:
  s1 = "Tag.gtype"[] []  # shift register
  while {
    # s1: >SL Tags>
    event {
      on "Progress" Value changed; "Test Error" Value changed; "Test Running" Value changed {
        Array Index(array=s1) -> (out0[_]=w3, out1[_]=w4, out2[_]=w5)
        # Test Error
        call "Write Tag (Boolean).gvi"(tag in=w5, value=$"Test Error", error in=no error) -> (error out=w6)
        # Test Progress
        call "Write Tag (I32).gvi"(tag in=w4, value=$Progress, error in=w6) -> (error out=w7)
        # Test Running
        call "Write Tag (Boolean).gvi"(tag in=w3, value=$"Test Running", error in=w7) -> (error out=w1)
        w2 = s1
      }
      on "Connect" Value changed {
        w8 = [{"Name"="SystemLink.Examples.TestRunning", "data type"="Boolean"}, {"Name"="SystemLink.Examples.Progress", "data type"="I32"}, {"Name"="SystemLink.Examples.TestError", "data type"="Boolean"}]
        case ($"Authentication Credentials") {
          frame 0, Default {
            call "Open Configuration.gvi"(server url=$"server url", username=$username, password=$password, error in=no error) -> (configuration=w9, error out=w10)
          }
          frame 1 {
            call "Open Configuration API Key.gvi"(server url="https://api.systemlinkcloud.com", api key=$"API Key", error in=no error) -> (configuration=w9, error out=w10)
          }
        }
        s2 = w10  # shift register
        for {
          w11 = each element of w8
          Property Node(instance in=w11) -> ("Name"=w12, "data type"=w13)
          call "Open Tag.gvi"(path=w12, data type=w13, error in=s2, configuration=w9) -> (tag=w14, error out=w15)
          append w14 to w2
          next s2 = w15
        }
        w1 = s2
      }
    }
    $Errors <- w1
    next s1 = w2
    stop if FALSE
  }
