vi "Send Command.gvi"   [LabVIEW NXG 5.1.0]
inputs:
  "To Send Command": string
  "Error In": error
outputs:
  "JS reference": "NI.JavaScriptReference"
  "Error Out": error
uses:
  WebApp::Library.jsli::Eval
diagram:
  w1 = """var stringtotest = `%s`
try{
	var messageObj = {to_execute_code: stringtotest};
	var stringifiedMessageObj = JSON.stringify(messageObj);
	webkit.messageHandlers.cordova_iab.postMessage(stringifiedMessageObj);
} catch(error){
	alert(error);
}"""
  Format Into String(formatString=w1, errIn=$"Error In", $"To Send Command") -> (outString=w2, errOut=w3)
  call "Eval"(evalString=w2, error in=w3) -> (return=w4, error out=w5)
  $"JS reference" <- w4
  $"Error Out" <- w5
