vi "index.gviweb"   [LabVIEW NXG 5.1.0]
panel controls:
  "Authentication Credentials": i32
  "server url": string = "http://192.168.195.141"
  "username": string = "admin"
  "password": string
  "API Key": string
  "connect": bool
panel indicators:
  "Errors": error
  "cluster out": T1
types:
  T1 = cluster{"ID": i32, "Test Running": bool, "Test Error": bool, "Progress": i32}
  "DataType.gtype" = enum{"Double", "I32", "String", "Boolean", "U64", "Timestamp"}
  "Client Handle.gtype" = u32
  "Configuration.gtype" = cluster{"Server URL": string, "Session": "Client Handle.gtype", "Raw Session Queue": Queue<"Client Handle.gtype">}
  "Tag.gtype" = cluster{"Path": string, "Datatype": "DataType.gtype", "Configuration": "Configuration.gtype"}
uses:
  NI::Skyline::TagHTTP::Read Tag (Boolean).gvi
  NI::Skyline::TagHTTP::Read Tag (I32).gvi
  WebApp::Send Command.gvi
  NI::Skyline::Configuration::Open Configuration.gvi
  NI::Skyline::Configuration::Open Configuration API Key.gvi
  NI::Skyline::TagHTTP::Open Tag.gvi
diagram:
  # ID is currently hard coded.
  # You could generate it dynamically if you want multiple
  # popups
  w1 = T1 {"ID"=1207, "Test Running"=FALSE, "Test Error"=FALSE, "Progress"=0}
  s1 = "Tag.gtype"[] []  # shift register
  s2 = w1  # shift register
  while {
    # s1: >SL Tags>
    event (timeout = 200) {
      on "Timeout" {
        Array Index(array=s1) -> (out0[_]=w5, out1[_]=w6, out2[_]=w7)
        # Test Error
        call "Read Tag (Boolean).gvi"(tag in=w7, error in=no error) -> (value=w8, error out=w9)
        # Test Progress
        call "Read Tag (I32).gvi"(tag in=w6, error in=w9) -> (value=w10, error out=w11)
        # Test Running
        call "Read Tag (Boolean).gvi"(tag in=w5, error in=w11) -> (value=w12, error out=w13)
        Property Node(instance in=s2, "Test Running"=w12, "Progress"=w10, "Test Error"=w8) -> (instance out=w14)
        Is Not Equal(x=s2, y=w14) -> w15
        Cluster To Array(cluster=w15) -> (array=w16)
        # on any change
        Or Array Elements(Boolean array=w16) -> (logical OR=w17)
        case (w17) {
          frame False, Default {
            w4 = w14
            w2 = w13
          }
          frame True {
            Property Node(instance in=w14) -> ("Test Running"=w18, "Test Error"=w19, "Progress"=w20, instance out=w4)
            Select(s=w18, t="Test Running", f="Test Finished") -> w21
            Select(s=w19, t="Test Error", f=w21) -> w22
            case (w20) {
              frame -1, Default {
                w25 = "cordova.plugins.notification.local.schedule({\n\tid:%d,\n\ttitle: 'My amazing testbench',\n\ttext: '%s',\n\tforeground: true\n});"  # Notification
                Property Node(instance in=w4) -> ("ID"=w26)
                Format Into String(formatString=w25, errIn=w13, w26, w22) -> (outString=w24, errOut=w23)
              }
              frame 0..100 {
                w27 = """cordova.plugins.notification.local.schedule({
	id:%d,
	title: 'My amazing testbench',
	text: '%s',
	progressBar: { value: %d},
	foreground: true
});"""  # Notification with progressbar
                Property Node(instance in=w4) -> ("ID"=w28)
                Format Into String(formatString=w27, errIn=w13, w28, w22, w20) -> (outString=w24, errOut=w23)
              }
            }
            call "Send Command.gvi"(To Send Command=w24, Error In=w23) -> (Error Out=w2)
          }
        }
        $"cluster out" <- w14
        w3 = s1
      }
      on "connect" Value changed {
        w29 = [{"Name"="SystemLink.Examples.TestRunning", "data type"="Boolean"}, {"Name"="SystemLink.Examples.Progress", "data type"="I32"}, {"Name"="SystemLink.Examples.TestError", "data type"="Boolean"}]
        case ($"Authentication Credentials") {
          frame 0, Default {
            call "Open Configuration.gvi"(server url=$"server url", username=$username, password=$password, error in=no error) -> (configuration=w30, error out=w31)
          }
          frame 1 {
            call "Open Configuration API Key.gvi"(server url="https://api.systemlinkcloud.com", api key=$"API Key", error in=no error) -> (configuration=w30, error out=w31)
          }
        }
        s3 = w31  # shift register
        for {
          w32 = each element of w29
          Property Node(instance in=w32) -> ("Name"=w33, "data type"=w34)
          call "Open Tag.gvi"(path=w33, data type=w34, error in=s3, configuration=w30) -> (tag=w35, error out=w36)
          append w35 to w3
          next s3 = w36
        }
        w2 = s3
        w4 = s2
      }
    }
    $Errors <- w2
    next s1 = w3
    next s2 = w4
    stop if FALSE
  }
